# Dynamo graph Winforms_02_Select Elements.dyn "241111_Winforms seleccion elementos" (Dynamo 2.16.2.5624)

# group: OUTPUT: A REVIT
# note: USO:
# GRUPOS DE CÓDIGO QUE SIRVEN PARA LA EXPORTACIÓN DE DATOS A REVIT.
# NORMALMENTE REPRESENTA EL FINAL DEL CÓDIGO
# note: SALIDA DE DATOS A REVIT

# group: PROCESO
# note: USO:
# GRUPO DE CODIGO QUE FORMA PARTE DEL PROCESO.
# note: PROCESO

# group: INPUT
# note: INPUT
# note: USO:
# ESPECIAL ATENCION POR PARTE DEL USUARIO DEL SCRIPT.
# SE REQUIERE LA SELECCIÓN DE OPCIONES, RUTAS DE ARCHIVOS, DATOS...
# EL INCORRECTO RELLENO DE LA INFORMACION PUEDE AFECTAR EL FUNCIONAMIENTO CORRECTO DEL SCRIPT.

# group: Dynamo 2.x_TEMPLATE_07_230721
# note: CREADO POR: ALVARO CARNICERO
# CONSULTAS A: alvaro.carnicero@gmail.com
# CREADO: 220415
# ULTIMA EDICION: 230721
# DYNAMO VERSION: <Dynamo 2.6.1.X>

# group: GUIA
# note: GUIA PARA EL USUARIO DE ESTE CODIGO.
# 1. El usuario sólo debe atender los grupos de código con descripción INPUT de color AZUL.
# 2. Este código puede complementarse con el trabajo de otros códigos. Consulta en INFORMACION DEL CODIGO.
# 3. El script está preparado para usar en Dynamo Player. Salvo casos advertidos previamente.
# 4. Nunca cambiar los nodos, sus conexiones, sus nombres, descripciones, agrupaciones, etcétera.
# 5. Consultar al creador del script para cualquier duda, mal funcionamiento, error o sugerencia.
# alvaro.carnicero@gmail.com

# group: OUTPUT: A EXCEL
# note: USO:
# GRUPOS DE CÓDIGO QUE SIRVEN PARA LA EXPORTACIÓN A EXCEL.
# note: SALIDA DE DATOS A EXCEL

# group: INPUTS: INSTRUCCIONES
anotaciones_específicas_de_la = StringInput("""- Título: 

- Objetivo: 		

- Protocolo: 		

- Instrucciones:	
Seleccionar elementos
Aportar ruta archivo para exportación de datos (incluido nombre de archivo y extensión .xlsx)

- Consultas: alvaro.carnicero@gmail.com

- Fecha creacción:
230309

- Fechas de edición: 

- Versión Revit: 
20xx

- Proyecto para el que se ha usado:
 """)  # "Anotaciones específicas de la rutina:"; graph input

# group: Python a traves de VS
file_path = Filename(".\241111_Winforms seleccion elementos.py")
readText = FileSystem.ReadText(file=file_path)
python_script_from_string = PythonStringNode(script=readText)  # CPython3
type = Object.Type(object=python_script_from_string)
watch = Watch(python_script_from_string)

# group: OUTPUTS: RESULTADOS
output_2_analisis_de_resultados = Watch(python_script_from_string)  # graph output
